# Grasshopper definition quick_start.ghx (Grasshopper 1.0.8)
# plug-ins: Form Flux

density = ValueList({"%0": 0, "%25": 25, "%50": 50, "%75": 75, "%100": 100}, selected="%25")
building_type = ValueList({"Courtyard": 0, "Linear": 1, "Point": 2, "L-shape": 3, "U-shape": 4}, selected=["Courtyard", "U-shape"])
tree_config = TreeConfig(
    TreeDensity=density,
    MinDiameter=Slider(3, range=0..10),
    MaxDiameter=Slider(6, range=0..10),
    GenerateInCourtyards=Toggle(True))
seed = Slider(76, range=0..100)
reference_boundary = Curve(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)
form_flux = FormFlux(
    Boundary=reference_boundary,
    Setback=3,
    BuildingDepth=12,
    MinFootprintArea=100,
    Floors_min=3,
    Floors_max=6,
    FloorHeight=4,
    Divisions=Slider(4, range=0..10),
    StreetWidth=2,
    BuildingTypes=building_type,
    NumParks=2,
    GenerateFloorSlabs=False,
    Trees=tree_config,
    Seed=seed)  # -> Footprints, Masses, Heights, Streets, FloorSlabs, Parks, Courtyards, Trees, Parcels, Metrics
