# Grasshopper definition quick_start.ghx (Grasshopper 1.0.8)
# plug-ins: Form Flux

building_type = ValueList({"Courtyard": 0, "Linear": 1, "Point": 2, "L-shape": 3, "U-shape": 4}, selected=["Courtyard", "L-shape"])
seed = Slider(32, range=0..100)
division = Slider(4, range=0..10)
reference_boundary = Curve(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)
form_flux = FormFlux(
    Boundary=reference_boundary,
    Setback=3,
    BuildingDepth=12,
    MinFootprintArea=100,
    Floors_min=3,
    Floors_max=6,
    FloorHeight=4,
    Divisions=division,
    StreetWidth=2,
    BuildingTypes=building_type,
    NumParks=2,
    TreeDensity=Slider(0, range=0..100),
    GenerateFloorSlabs=False,
    Seed=seed)  # -> Footprints, Masses, Heights, Streets, FloorSlabs, Parks, Trees, Parcels, Metrics
